# Grasshopper definition GH_UR_RoboticAssistedMetalPolishing.gh (Grasshopper 1.0.7)
# Copyright: GPL v3
# plug-ins: HAL for Grasshopper, Robots, G E N E R A T I O N, MetaHopper

input_resolution_targetpointwithinsegmen = Slider(3, range=1..50)  # "INPUT_Resolution/TargetPointWithinSegment_VValue_Int"
input_numberofsegment_uvalue_int = Slider(60, range=0..100)
input_offsetfromstartingpln_mm_float = Slider(100, range=0..1000)
input_offsetfromtargetplane_mm_float = Slider(20, range=0..1000)
input_startsimulation_bool = BooleanToggle(False)
input_pausesimulation_bool = Button()

# ---- group: UPLOAD ROBOT PROGRAM THROUGH IP
# 03
# Communicate With Physical Robot
input_uploadprogram = Button()
input_playprogram = Button()
input_pauseprogram = Button()

# ----
list = ValueList({"Joint", "Linear"}, selected="Linear")
input_workingsurface_srf = Surface(reparameterize(<surface referenced from the Rhino model>))
input_robotmotiontype = Data(list)
docinfo = DocumentInfo(AutoUpdate=Button(), Recursive=False)  # -> DocumentName, DocumentFilePath, Components, Params, _3rdPartyAssemblies
input_offsetfromstartingpln_mm_float_2 = Data(input_offsetfromstartingpln_mm_float)
input_numberofsegment_uvalue_int_2 = Data(input_numberofsegment_uvalue_int)
input_startsimulation_bool_2 = Data(input_startsimulation_bool)
input_pausesimulation_bool_2 = Data(input_pausesimulation_bool)
input_offsetfromtargetplane_mm_float_2 = Data(input_offsetfromtargetplane_mm_float)
input_resolution_targetpointwithinsegmen_2 = Data(input_resolution_targetpointwithinsegmen)  # "INPUT_Resolution/TargetPointWithinSegment_VValue_Int"
# Package(s) Needed: Robot (https://www.food4rhino.com/en/app/robots)
# READ ME
# Note(s): 1. Make sure the Rhino project is in "mm".
# 3. Connect to the same network as the robots.
panel = Panel(docinfo._3rdPartyAssemblies)

# ---- group: UPLOAD ROBOT PROGRAM THROUGH IP
# Tested In: YYMMDD_In Rhino 7_weiwin.loy@hdr.qut.edu.au.
input_uploadprogram_2 = Data(input_uploadprogram)
input_pauseprogram_2 = Data(input_pauseprogram)
input_playprogram_2 = Data(input_playprogram)

# ---- group: How fast does the robot going to move?
# 01a
input_robot_speed_mm_s = Slider(55, range=30..80)

# ---- group: How robot parameter blend together?
# HOME POSITION
input_blendradius_mm = Slider(1, range=0..100)
input_blendradius_mm_2 = Data(input_blendradius_mm)

# ---- group: How robot configured?
list_2 = FlagFields({"Shoulder": 1, "Elbow": 2, "Wrist": 4}, selected="Shoulder")
input_robotconfiguration = Data(list_2)

# ----
# USER INPUTS
# BASIC PARAMETERS
# 02
# Robot Type?
robots_library = RobotsLibrary(
    {"ABB CRB15000-5", "ABB CRB15000-10", "ABB CRB15000-12", "UR3e", "UR5e", "UR10e", "UR16e", "UR3", "UR5", "UR10"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}, selected="UR10",
    Type=0)

input_robotpln = Data(PlaneXY(0, 0, 0))

# ---- group: How fast does the robot going to move?
# Established Robot Homing Parameters
create_speed = CreateSpeed(
    Translation=input_robot_speed_mm_s,
    Rotation=3.141592654,
    ExternalTranslation=5000,
    ExternalRotation=18.84955592,
    AccelTranslation=2500,
    AccelAxis=12.56637061)
input_robotspeed = Data(create_speed)

# ----
# AUTOMATIC INPUTS
load_robot_system = LoadRobotSystem(Name=robots_library, Base=input_robotpln)
# HELPERS
# PROCESSING FUNCTIONS
# MAIN FUNCTION
# ROBOT TOOLPATH
# 01
output_robottype = Data(load_robot_system)

output_robottype_2 = Data(output_robottype)

degtorad = DegreesToRadians(Degrees=[0, -90, -90, -90, 90, 0], RobotSystem=output_robottype_2, MechanicalGroup=0)
input_robotjointdegree_rad = Data(degtorad)

# ----
# 02
input_robotjointdegree_rad_2 = Data(input_robotjointdegree_rad)
input_robotspeed_2 = Data(input_robotspeed)
input_blendradius_mm_3 = Data(input_blendradius_mm_2)

input_offsetfromstartingpln_mm_float_3 = Data(input_offsetfromstartingpln_mm_float_2)
input_offsetfromtargetplane_mm_float_3 = Data(input_offsetfromtargetplane_mm_float_2)

input_resolution_targetpointwithinsegmen_3 = Data(input_resolution_targetpointwithinsegmen_2)  # "INPUT_Resolution/TargetPointWithinSegment_VValue_Int"
geo = Geometry(<brep referenced from the Rhino model>)
input_numberofsegment_uvalue_int_3 = Data(input_numberofsegment_uvalue_int_2)
bbox = BoundingBox(Content=geo, Plane=PlaneXY(0, 0, 0), UnionBox=True)  # -> Box, Box_2
box = EvaluateBox(Box=bbox.Box, UParameter=0.5, VParameter=0.5, WParameter=1)  # -> Plane, Point, Include
boxprop = BoxProperties(Box=bbox.Box)  # -> Center, Diagonal, Area, Volume, Degeneracy
devec = DeconstructVector(Vector=boxprop.Diagonal)  # -> XComponent, YComponent, ZComponent
addition = Addition(A=input_resolution_targetpointwithinsegmen_3, B=1, C=2)
merge = Merge(Data1=devec.XComponent, Data2=devec.YComponent)
avr = Average(Input=merge)
mesh = Mesh(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)
division = Division(A=avr, B=2)
dom = ConstructDomain(DomainStart=expr("x", division), DomainEnd=expr("-x", division))
mjoin = MeshJoin(Meshes=mesh)
rectangle = Rectangle(Plane=box.Plane, XSize=dom, YSize=dom, Radius=0)  # -> Rectangle, Length
srf = Surface(rectangle.Rectangle)
srf_2 = Surface(srf)
sdivide = DivideSurface(Surface=reparameterize(srf_2), UCount=2, VCount=input_numberofsegment_uvalue_int_3)  # -> simplify(Points), Normals, simplify(Parameters)
branch = TreeBranch(Tree=sdivide.Points, Path="{1}", MaintainPaths=True)
pline = PolyLine(Vertices=branch, Closed=False)  # -> flatten(Polyline)
explode = Explode(Curve=pline, Recursive=True)  # -> Segments, simplify(Vertices)
srf_cp = SurfaceClosestPoint(Point=explode.Vertices, Surface=reparameterize(srf_2))  # -> Point, simplify(UVPoint), Distance
evalsrf = EvaluateSurface(Surface=reparameterize(srf_2), Point=srf_cp.UVPoint)  # -> Point, Normal, UDirection, VDirection, flatten(Frame)
data = Data(evalsrf.Frame)
data_2 = Data(graft(data))
repeat = RepeatData(Data=data_2, Length=addition)  # -> flatten(Data)
lng = ListLength(List=flatten(repeat))
series = Series(Start=0, Step=1, Count=lng)
concat = Concatenate(FragmentA="tool", FragmentB=series)
tool = CreateTool(Name=concat, TCP=repeat, Weight=0, Mesh=mjoin)  # -> flatten(Tool), TCP
output_tcp_tools = Data(tool.Tool)
output_tcp_tools_2 = Data(output_tcp_tools)
output_tcp_tools_3 = Data(output_tcp_tools)
item = ListItem(List=output_tcp_tools_2, Index=[0, -1], Wrap=True)
dispatch = Dispatch(List=item, DispatchPattern=[True, False])  # -> OUTPUT_FirstTCP, OUTPUT_LastTCP
output_lasttcp_tool = Data(dispatch.OUTPUT_LastTCP)
output_lasttcp_tool_2 = Data(output_lasttcp_tool)
output_firsttcp_tool = Data(dispatch.OUTPUT_FirstTCP)
output_firsttcp_tool_2 = Data(output_firsttcp_tool)
merge_2 = Merge(Data1=output_firsttcp_tool_2, Data2=output_tcp_tools_3, Data3=output_lasttcp_tool_2)
output_robottool = Data(merge_2)

output_firsttcp_tool_3 = Data(output_firsttcp_tool)

# ----
# Compiler into Robot Language
target = CreateTarget(
    Joints=input_robotjointdegree_rad_2,
    Tool=output_firsttcp_tool_3,
    Speed=input_robotspeed_2,
    Zone=input_blendradius_mm_3,
    IsCartesian=False)
output_robottarget_home = TargetParameter(target)

# ----
# 02
input_resolution_targetpointwithinsegmen_4 = Data(input_resolution_targetpointwithinsegmen_2)  # "INPUT_Resolution/TargetPointWithinSegment_VValue_Int"
input_workingsurface_srf_2 = Surface(reparameterize(input_workingsurface_srf))
input_numberofsegment_uvalue_int_4 = Data(input_numberofsegment_uvalue_int_2)
# Base Geometry
input_workingsurface_srf_3 = Surface(reparameterize(input_workingsurface_srf))
# UI / OUTPUTS
cluster = Cluster_3(
    input_workingsurface_srf=input_workingsurface_srf_3,
    input_numberofsegment_uvalue_int=input_numberofsegment_uvalue_int_4,
    input_resolution_targetpointwithinsegmen=input_resolution_targetpointwithinsegmen_4)
# Convert Base Geometry to Target Points
cluster_2 = Cluster_2(
    input_workingsurface_srf=input_workingsurface_srf_2,
    output_sortedlinepath_crv=cluster,
    input_offsetfromtargetplane_mm_float=input_offsetfromtargetplane_mm_float_3)
cluster_3 = Cluster_4(output_collectedtargetplns_pln=cluster_2, input_offsetfromstartingpln_mm_float=input_offsetfromstartingpln_mm_float_3)

output_robottool_2 = Data(simplify(graft(output_robottool)))
input_robotmotiontype_2 = Data(input_robotmotiontype)
# 02
output_configuredtargetplns_pln = Data(simplify(graft(cluster_3)))
input_robotspeed_3 = SpeedParameter(input_robotspeed)
# Convert Base Geometry to Target Points
target_2 = CreateTarget(
    Plane=output_configuredtargetplns_pln,
    Motion=input_robotmotiontype_2,
    Tool=output_robottool_2,
    Speed=input_robotspeed_3,
    Zone=Slider(1, range=0..10),
    IsCartesian=True)  # -> flatten(Target)
output_robottargetpath = TargetParameter(target_2)

output_robottarget_home_2 = TargetParameter(output_robottarget_home)
output_robottargetpath_2 = TargetParameter(output_robottargetpath)
merge_3 = Merge(Data1=output_robottarget_home_2, Data2=output_robottargetpath_2, Data3=output_robottarget_home_2)
output_robottarget = TargetParameter(merge_3)

# ---- group: Online control via Ethernet
input_useofflinesimulator = BooleanToggle(False)
input_useftpupload = BooleanToggle(False)

# ---- group: SAFE ROBOT PROGRAM
input_saveprogram_bool = Button()
input_robotpath = Panel("C:\Users\loywe\OneDrive - Queensland University of Technology\Phd Loy Wei Win")
# Save Program (USB)
input_saveprogram_bool_2 = Data(input_saveprogram_bool)
input_robotpath_2 = Data(input_robotpath)

# ----
# CREATE PROGRAM & SENT IT
input_saveprogram_bool_3 = Data(input_saveprogram_bool_2)
input_uploadprogram_3 = Data(input_uploadprogram_2)

input_programname = Panel("program")
input_programindex = Panel("01_")

or = GateOr(A=input_saveprogram_bool_3, B=input_uploadprogram_3)

get_current_time = GetCurrentTime(get_time=or)  # -> out, time_string; inputs get_time: Boolean
# ---------- get_current_time: Python ----------
__author__ = "WeiWinLoy"

import rhinoscriptsyntax as rs
from datetime import datetime 

def give_time(): 
    time = datetime.now()
    time_string = time.strftime("%y%m%d_%H%M%S")
    return time_string
    
if get_time: 
    time_string = give_time()
# ---------- end get_current_time ----------
# COMMENT: The new program sent to the robot via ftp will only be automatically loaded if it has a different name than the one that was sent previously.
# We change the name of the program  by appending the current date and time
input_getcurrenttime = Data(get_current_time.time_string)

input_getcurrenttime_2 = Data(input_getcurrenttime)

concatenate = Concatenate(Fragment_A=input_programname, Fragment_B=input_programindex, Fragment_C=input_getcurrenttime_2)
output_programname = Data(concatenate)

# ---- group: CREATE PROGRAM
# 01
output_programname_2 = Data(output_programname)
output_robottype_3 = RobotSystemParameter(output_robottype)
output_robottarget_2 = TargetParameter(output_robottarget)

# Create Basic Program
program = CreateProgram(Name=output_programname_2, RobotSystem=output_robottype_3, Targets=output_robottarget_2, StepSize=1)  # -> Program, Code, Duration, Warnings, Errors
output_program = ProgramParameter(program.Program)
output_errormessage = Data(program.Errors)
output_programcode = Data(program.Code)
output_warnings = Data(program.Warnings)

# ----
# 02a
output_errors = Data(output_errormessage)
output_errors_2 = Panel(output_errors)

input_robotpath_3 = Data(input_robotpath_2)
output_program_2 = Data(output_program)

saveprog = SaveProgram(Program=output_program_2, Folder=input_robotpath_3)

output_warnings_2 = Data(output_warnings)
output_warnings_3 = Panel(output_warnings_2)

input_startsimulation_bool_3 = Data(input_startsimulation_bool_2)
input_pausesimulation_bool_3 = Data(input_pausesimulation_bool_2)
session_settings = SessionSettings()

# ---- group: BACKEND
output_errormessage_2 = Data(output_errormessage)
output_programcode_2 = Data(output_programcode)

loy_backendchecking = LOY_BackendChecking(output_programcode=output_programcode_2, output_error=output_errormessage_2)  # -> output_needtouseftpupload_2, output_colorvalue_2, output_error_4, output_textmessage_2
output_robotmesh_colour = Data(loy_backendchecking.output_colorvalue_2)
input_needtouseftpupload = Data(loy_backendchecking.output_needtouseftpupload_2)

# ---- group: Online control via Ethernet
# COMMENT: Use FTP Upload if you are going to sent a long code.
input_needtouseftpupload_2 = Data(input_needtouseftpupload)
input_robotip = Panel("192.168.1.180")
input_ftp_ursim_filepath = Panel("/home/ur/ursim-current/programs/")
# Remote Control
or_2 = GateOr(A=input_useftpupload, B=input_needtouseftpupload_2)

establish_robotipformat = Establish_RobotIPFormat(
    input_useofflinesimulator=input_useofflinesimulator,
    input_useftpupload=or_2,
    input_robotip=input_robotip,
    ftp_ursim_filepath=input_ftp_ursim_filepath)  # -> flatten(robotip_txt_2)
input_robotip_2 = Data(establish_robotipformat)

# ----
input_robotip_3 = Data(input_robotip_2)
input_uploadprogram_4 = Data(input_uploadprogram_2)
input_playprogram_3 = Data(input_playprogram_2)
# 02b
input_pauseprogram_3 = Data(input_pauseprogram_2)
output_program_3 = Data(output_program)

remote_connection = RemoteConnection(
    Program=output_program_3,
    IP=input_robotip_3,
    Upload=input_uploadprogram_4,
    Play=input_playprogram_3,
    Pause=input_pauseprogram_3)
panel_2 = Panel(remote_connection)

# ---- group: BACKEND (continued)
output_containederror_bool = Boolean(loy_backendchecking.output_error_4)
output_textmessage = Data(loy_backendchecking.output_textmessage_2)

# ----
trigger = Trigger(Interval=10, TimerInterval=10, Target=count)
output_error = Boolean(invert(output_containederror_bool))
# VISUALISATION
output_program_4 = ProgramParameter(output_program)
and = GateAnd(A=output_error, B=input_startsimulation_bool_3)
count = Counter(Start=0, Step=0.05, Pause=input_pausesimulation_bool_3, Reset=invert(and))
sim = ProgramSimulation(Program=output_program_4, Time=count, Normalized=invert(True))  # -> SystemMeshes, JointRotations, Plane, Index, Time, Program, Errors
draw_trail = DrawTrail(P=sim.Program)
output_robotmesh_colour_2 = Data(output_robotmesh_colour)
output_textmessage_2 = Data(output_textmessage)
cluster_4 = Cluster(input_textmessage=output_textmessage_2, G=sim.SystemMeshes, M=output_robotmesh_colour_2, L=sim.Plane)

# ==== cluster Cluster
L = ClusterInput()
item = ListItem(List=L, Index=-1, Wrap=True)
input_textmessage = ClusterInput()
msphere = MeshSphere(Base=item, Radius=Slider(5, range=0..10), UCount=10, VCount=20)
M = ClusterInput()
G = ClusterInput()
preview = CustomPreview(Geometry=msphere, Material=M)
input_textmessage_2 = Data(input_textmessage)
preview_2 = CustomPreview(Geometry=G, Material=M)
tag = TextTag(Location=item, Text=input_textmessage_2, Colour=ColourSwatch(SwatchColor=RGBA(122, 114, 114, 158)))

# ==== cluster Establish_RobotIPFormat
input_useofflinesimulator = ClusterInput()
input_useftpupload = ClusterInput()
input_robotip = ClusterInput()
ftp_ursim_filepath = ClusterInput()
input_useofflinesimulator_2 = Boolean(input_useofflinesimulator)
input_useftpupload_2 = Boolean(input_useftpupload)
input_robotip_2 = Text(input_robotip)
ftp_ursim_login = Panel("ur:easybot@")
ftp_ursim_filepath_2 = Text(ftp_ursim_filepath)
ftp_prefix = Panel("sftp://")
concatenate = Concatenate(Fragment_A=ftp_prefix, Fragment_C=input_robotip_2)
concatenate_2 = Concatenate(Fragment_A=ftp_prefix, Fragment_B=ftp_ursim_login, Fragment_C=input_robotip_2, A=ftp_ursim_filepath_2)
stream_filter = StreamFilter(Gate=input_useofflinesimulator_2, Stream0=concatenate, Stream1=concatenate_2)
stream_filter_2 = StreamFilter(Gate=input_useftpupload_2, Stream0=input_robotip_2, Stream1=stream_filter)
robotip_txt = Text(stream_filter_2)
robotip_txt_2 = ClusterOutput(robotip_txt)

# ==== cluster LOY_BackendChecking
output_programcode = ClusterInput()
output_error = ClusterInput()
output_programcode_2 = Data(output_programcode)
number_slider = Slider(2000, range=0..10000)
lng = ListLength(List=output_programcode_2)
output_error_2 = Data(output_error)
txt = Text(ColourSwatch(SwatchColor=RGBA(255, 102, 102, 129)))
txt_2 = Text(ColourSwatch(SwatchColor=RGBA(255, 255, 255, 81)))
expression = Expression(x=lng, y=number_slider, Expression="if(x≥y,true,false)")
expression_2 = Expression(x=lng, y=number_slider, a=txt, b=txt_2, Expression="if(x≥y,a,b)")
expression_3 = Expression(x=lng, y=number_slider, a=txt, b=txt_2, Expression="if(x≥y,\"Too many planes\",\"\")")
null = NullItem(Item=output_error_2)  # -> NullFlags, InvalidFlags, Description
avr = Average(Input=null.NullFlags)
col = Colour(expression_2)
output_needtouseftpupload = Data(expression)
filter = StreamFilter(Gate=avr, Stream0="Error", Stream1=expression_3)
filter_2 = StreamFilter(Gate=avr, Stream0=ColourSwatch(SwatchColor=RGB(255, 0, 0)), Stream1=col)
output_needtouseftpupload_2 = ClusterOutput(output_needtouseftpupload)
output_error_3 = Boolean(invert(avr))
output_colorvalue = Data(filter_2)
output_textmessage = Data(filter)
output_colorvalue_2 = ClusterOutput(output_colorvalue)
output_error_4 = ClusterOutput(output_error_3)
output_textmessage_2 = ClusterOutput(output_textmessage)

# ==== cluster DrawTrail
P = ClusterInput()

# ---- group: Draw trail
trail = SimpleTrail(Program=P, Length=Slider(100000, range=0..100000), MechanicalGroup=0)
swatch = ColourSwatch(SwatchColor=RGB(0, 0, 0))

# ----
preview = CustomPreview(Geometry=trail, Material=swatch)

# ==== cluster Cluster_2
input_offsetfromtargetplane_mm_float = ClusterInput()
input_workingsurface_srf = ClusterInput()
output_sortedlinepath_crv = ClusterInput()
input_offsetfromtargetplane_mm_float_2 = Data(input_offsetfromtargetplane_mm_float)
input_workingsurface_srf_2 = Surface(reparameterize(input_workingsurface_srf))
output_sortedlinepath_crv_2 = Data(output_sortedlinepath_crv)
explode = Explode(Curve=output_sortedlinepath_crv_2, Recursive=True)  # -> Segments, simplify(Vertices)
srf_cp = SurfaceClosestPoint(Point=explode.Vertices, Surface=input_workingsurface_srf_2)  # -> Point, UVPoint, Distance
evalsrf = EvaluateSurface(Surface=input_workingsurface_srf_2, Point=srf_cp.UVPoint)  # -> Point, Normal, UDirection, VDirection, Frame

# ---- group: FINAL ITEM
item = ListItem(List=evalsrf.Frame, Index=-1, Wrap=True)

# ---- group: FIRST ITEM
item_2 = ListItem(List=evalsrf.Frame, Index=0, Wrap=True)

# ----
pl_offset = PlaneOffset(BasePlane=item_2, Offset=input_offsetfromtargetplane_mm_float_2)
pl_offset_2 = PlaneOffset(BasePlane=item, Offset=input_offsetfromtargetplane_mm_float_2)
merge = Merge(Data1=pl_offset, Data2=evalsrf.Frame, Data3=pl_offset_2)
clean = CleanTree(RemoveNulls=True, RemoveInvalid=True, RemoveEmpty=False, Tree=merge)
output_collectedtargetplns_pln = Data(flatten(clean))
output_collectedtargetplns_pln_2 = ClusterOutput(output_collectedtargetplns_pln)

# ==== cluster Cluster_3
input_resolution_targetpointwithinsegmen = ClusterInput()  # "INPUT_Resolution/TargetPointWithinSegment_VValue_Int"
input_numberofsegment_uvalue_int = ClusterInput()
input_workingsurface_srf = ClusterInput()
input_resolution_targetpointwithinsegmen_2 = Data(input_resolution_targetpointwithinsegmen)  # "INPUT_Resolution/TargetPointWithinSegment_VValue_Int"
input_numberofsegment_uvalue_int_2 = Data(input_numberofsegment_uvalue_int)
input_workingsurface_srf_2 = Surface(reparameterize(input_workingsurface_srf))
sdivide = DivideSurface(
    Surface=input_workingsurface_srf_2,
    UCount=input_numberofsegment_uvalue_int_2,
    VCount=input_resolution_targetpointwithinsegmen_2)  # -> Points, Normals, simplify(Parameters)
pline = PolyLine(Vertices=sdivide.Points, Closed=False)  # -> flatten(Polyline)
dispatch = Dispatch(List=pline, DispatchPattern=[True, False])  # -> ListA, ListB
data = Data(dispatch.ListA)
data_2 = Data(dispatch.ListB)
flip = FlipCurve(Curve=data)  # -> Curve, Flag
weave = Weave(Pattern=[0, 1], Stream0=flip.Curve, Stream1=data_2, NullGaps=False)
output_sortedlinepath_crv = Data(weave)
output_sortedlinepath_crv_2 = ClusterOutput(output_sortedlinepath_crv)

# ==== cluster Cluster_4
output_collectedtargetplns_pln = ClusterInput()
input_offsetfromstartingpln_mm_float = ClusterInput()
output_collectedtargetplns_pln_2 = Data(flatten(output_collectedtargetplns_pln))
input_offsetfromstartingpln_mm_float_2 = Data(input_offsetfromstartingpln_mm_float)

# ---- group: INSERTION AND EXTRACTION POINT
item = ListItem(List=output_collectedtargetplns_pln_2, Index=[0, -1], Wrap=True)
pl_offset = PlaneOffset(BasePlane=item, Offset=input_offsetfromstartingpln_mm_float_2)

# ---- group: AVOID COLLISION
bbox = BoundingBox(Content=output_collectedtargetplns_pln_2, Plane=PlaneXY(0, 0, 0), UnionBox=True)  # -> Box, Box_2
box = EvaluateBox(Box=bbox.Box, UParameter=0.5, VParameter=0.5, WParameter=1)  # -> Plane, Point, Include

# ----
dispatch = Dispatch(List=pl_offset, DispatchPattern=[True, False])  # -> ListA, ListB
project = Project(Geometry=dispatch.ListB, Plane=box.Plane)  # -> Geometry, Transform
merge = Merge(Data1=dispatch.ListA, Data2=output_collectedtargetplns_pln_2, Data3=dispatch.ListB, Data4=project.Geometry)
pflip = FlipPlane(Plane=merge, ReverseX=False, ReverseY=False, SwapAxes=True)
output_configuredtargetplns_pln = Data(pflip)
output_configuredtargetplns_pln_2 = ClusterOutput(output_configuredtargetplns_pln)
